# Grasshopper definition 070819_RigidBodies.gh (Grasshopper 1.0.7)
# plug-ins: zFREP, Human, PhysX.GH, SpatialSlur.SlurGH

number_slider = Slider(50, range=0..100)
crv = Curve(<curve referenced from the Rhino model>)
mplane = MeshPlane(Boundary=crv, WidthCount=number_slider, HeightCount=number_slider)  # -> Mesh, Area
X = UnitX(Factor=expr("x*350 *-1", 1))
pt = Point([<point referenced from the Rhino model> x5])
move = Move(Geometry=flatten(pt), Motion=X)  # -> Geometry, Transform
crv_2 = Curve(<curve referenced from the Rhino model>)
crv_3 = Curve([<curve referenced from the Rhino model> x4])
topoly = CurveToPolyline(Curve=crv_2, ToleranceDistance=0, ToleranceAngle=0, MaxEdge=0.1)  # -> Polyline, Segments
meshfield_point = MeshFieldPoint(BaseMesh=mplane.Mesh, PointInput=move.Geometry, IsoValue=Slider(-0.85, range=-1..1))
merge = Merge(
    Data1=ColourSwatch(SwatchColor=RGB(255, 255, 255)),
    Data2=ColourSwatch(SwatchColor=RGB(54, 215, 255)),
    Data3=ColourSwatch(SwatchColor=RGB(0, 0, 0)))
mesh_field_curve = MeshFieldCurve(BaseMesh=mplane.Mesh, CurveInput=crv_3, IsoValue=Slider(0.3, range=-1..1))
mesh_field_curve_2 = MeshFieldCurve(BaseMesh=mplane.Mesh, CurveInput=topoly.Polyline, IsoValue=Slider(-0.5, range=-1..1))
field_display = FieldDisplay(Mesh=mplane.Mesh, Field=meshfield_point, Colors=merge)
X_2 = UnitX(Factor=expr("x*350", 1))
field_difference = FieldDifference(Field0=mesh_field_curve_2, Field1=mesh_field_curve)
move_2 = Move(Geometry=flatten(field_display), Motion=X_2)  # -> Geometry, Transform
merge_2 = Merge(
    Data1=ColourSwatch(SwatchColor=RGB(255, 255, 255)),
    Data2=ColourSwatch(SwatchColor=RGB(54, 215, 255)),
    Data3=ColourSwatch(SwatchColor=RGB(0, 0, 0)))
field_display_2 = FieldDisplay(Mesh=mplane.Mesh, Field=mesh_field_curve_2, Colors=merge_2)
isocontour = IsoContour(Mesh=mplane.Mesh, Field=field_difference, Iso=Slider(0.531, range=-1..1))  # disabled

# ---- group: Layer Height
layer_height = Slider(3.5, range=0..50)

# ---- group: normal crv
crv_4 = Curve(<curve referenced from the Rhino model>)

# ---- group: Orient
cluster = Cluster(G=mplane.Mesh, C=crv_4, L=layer_height)  # -> G_2, S, F

# ----
blend_fields = BlendFieldsMultiThreaded(BaseMesh=cluster.G_2, Field0=field_difference, Field1=meshfield_point, BlendParameters=cluster.S)
isocontour_2 = IsoContour(Mesh=cluster.G_2, Field=blend_fields, Iso=Slider(0.4, range=-1..1))
merge_3 = Merge(
    Data1=ColourSwatch(SwatchColor=RGB(255, 255, 255)),
    Data2=ColourSwatch(SwatchColor=RGB(54, 215, 255)),
    Data3=ColourSwatch(SwatchColor=RGB(0, 0, 0)))
smoothpline = SmoothPolyline(Polyline=isocontour_2, Strength=Slider(0.1, range=0..1), Times=Slider(50, range=0..1000))
field_display_3 = FieldDisplay(Mesh=cluster.G_2, Field=blend_fields, Colors=merge_3)
X_3 = UnitX(Factor=expr("x*700", 1))
move_3 = Move(Geometry=flatten(smoothpline), Motion=X_3)  # -> Geometry, Transform
X_4 = UnitX(Factor=expr("x*700", 1))
move_4 = Move(Geometry=flatten(field_display_3), Motion=X_4)  # -> Geometry, Transform
item = ListItem(List=move_4.Geometry, Index=0, Wrap=True)
len = Length(Curve=move_3.Geometry)
smaller = SmallerThan(FirstNumber=len, SecondNumber=Slider(100, range=0..100))  # -> SmallerThan, OrEqualTo
dispatch = Dispatch(List=move_3.Geometry, DispatchPattern=smaller.SmallerThan)  # -> ListA, ListB
lng = ListLength(List=move_4.Geometry)
explode = Explode(Curve=crv, Recursive=True)  # -> Segments, Vertices
demesh = DeconstructMesh(Mesh=move_4.Geometry)  # -> Vertices, Faces, Colours, Normals
divlength = DivideLength(Curve=reparameterize(dispatch.ListB), Length=Slider(1, range=0..100))  # -> Points, Tangents, Parameters
sqrt = SquareRoot(Value=lng)
len_2 = Length(Curve=explode.Segments)
# Fields Matrix
avr = Average(Input=demesh.Vertices)
pline = PolyLine(Vertices=divlength.Points, Closed=True)  # -> flatten(Polyline)
item_2 = ListItem(List=explode.Vertices, Index=0, Wrap=True)
round = Round(Number=sqrt)  # -> Nearest, Floor, Ceiling
item_3 = ListItem(List=len_2, Index=0, Wrap=True)
Y = UnitY(Factor=expr("x*-270", round.Ceiling))
move_5 = Move(Geometry=item_2, Motion=Y)  # -> Geometry, Transform
previewlw = CustomPreviewLineweights(Geometry=pline, Shader=ColourSwatch(SwatchColor=RGB(255, 255, 255)), Thickness=Slider(3, range=0..10), Absolute=False)
recgrid = Rectangular(Plane=move_5.Geometry, SizeX=item_3, SizeY=item_3, ExtentX=round.Ceiling, ExtentY=round.Nearest)  # -> flatten(Cells), Points
dam = DataDam(DataA=pline, BufferDelay=10000000, BufferMode=1)
pcen = PolygonCenter(Polyline=recgrid.Cells)  # -> CenterV, CenterE, CenterA
toolpath_resolution = Slider(5, range=0..10)
lng_2 = ListLength(List=pcen.CenterV)
subtraction = Subtraction(A=lng_2, B=lng)
divlength_2 = DivideLength(Curve=dam, Length=toolpath_resolution)  # -> Points, Tangents, Parameters
series = Series(Start=0, Step=1, Count=subtraction)
cull_i = CullIndex(List=pcen.CenterV, Indices=series, Wrap=True)  # -> graft(List)
cull_i_2 = CullIndex(List=recgrid.Cells, Indices=series, Wrap=True)  # -> graft(List)
Z = UnitZ(Factor=1)
# Toolpath Display
xprod = CrossProduct(VectorA=divlength_2.Tangents, VectorB=Z, Unitize=False)  # -> Vector, Length
vec2pt = Vector2Pt(PointA=avr, PointB=graft(cull_i), Unitize=False)  # -> Vector, Length
pl = ConstructPlane(Origin=divlength_2.Points, XAxis=xprod.Vector, YAxis=Z)
move_6 = Move(Geometry=graft(dam), Motion=vec2pt.Vector)  # -> Geometry, Transform
move_7 = Move(Geometry=graft(move_4.Geometry), Motion=vec2pt.Vector)  # -> flatten(Geometry), Transform
item_4 = ListItem(List=pl, Index=0, Wrap=True)
lng_3 = ListLength(List=pl)
previewlw_2 = CustomPreviewLineweights(Geometry=cull_i_2, Shader=ColourSwatch(SwatchColor=RGB(255, 255, 255)), Thickness=Slider(2, range=0..10), Absolute=False)
Z_2 = UnitZ(Factor=1)
ins = InsertItems(List=pl, Item=item_4, Indices=lng_3, Wrap=True)
move_8 = Move(Geometry=flatten(move_6.Geometry), Motion=Z_2)  # -> flatten(Geometry), Transform
cir = Circle(Plane=ins, Radius=Slider(1.5, range=0..50))
topoly_2 = CurveToPolyline(Curve=cir, ToleranceDistance=0, ToleranceAngle=0, MaxEdge=20)  # -> Polyline, Segments
previewlw_3 = CustomPreviewLineweights(
    Geometry=move_8.Geometry,
    Shader=ColourSwatch(SwatchColor=RGB(0, 0, 0)),
    Thickness=Slider(3, range=0..10),
    Absolute=False)
loft = MeshLoft(Polylines=topoly_2.Polyline)
merge_4 = Merge(Data1=ColourSwatch(SwatchColor=RGB(255, 255, 255)), Data2=ColourSwatch(SwatchColor=RGB(205, 79, 255)))
normshade = NormalShader(Mesh=loft, Colors=merge_4, Direction=Vector(0, 0, 1))
mjoin = MeshJoin(Meshes=flatten(normshade))
createatts = CreateAttributes(LayerName="Toolpath", enableFullPath=False)
createatts_2 = CreateAttributes(LayerName="Images", enableFullPath=False)
swatch = ColourSwatch(SwatchColor=RGB(0, 0, 0))
pi = Pi(Factor=Slider(0.2, range=0..1))
bake = BakeGeometry(Bake=Button(), Geometry=pline, Attributes=createatts, DeleteOldBakes=False, PreserveTrees=False)
bake_2 = BakeGeometry(Bake=Button(), Geometry=move_7.Geometry, Attributes=createatts_2, DeleteOldBakes=False, PreserveTrees=False)

# ---- group: Silhouette
c_script = CSharpScript(mesh=mjoin, c0=swatch, c1=swatch, w0=Slider(3, range=0..100), w1=Slider(1, range=0..100), minAngle=pi)  # -> out; inputs mesh: Mesh, c0: Color, c1: Color, w0: Int32, w1: Int32, minAngle: Double
# ---------- c_script: C# usings ----------
using System.IO;
using System.Linq;
using System.Data;
using System.Drawing;
using System.Reflection;
using System.Windows.Forms;
using System.Xml;
using System.Xml.Linq;
using System.Runtime.InteropServices;

using Rhino.DocObjects;
using Rhino.Collections;
using GH_IO;
using GH_IO.Serialization;
# ---------- c_script: C# ----------
    if(mesh == null)
      throw new ArgumentNullException();

    mesh.FaceNormals.ComputeFaceNormals();

    // cache display data
    _meshes.Add(mesh);
    _c0.Add(c0);
    _c1.Add(c1);
    _w0.Add(w0);
    _w1.Add(w1);
    _minAngles.Add(minAngle);

    //_clippingBox.Union(mesh.GetBoundingBox(false));
    _clippingBox = mesh.GetBoundingBox(false);
# ---------- c_script: C# additional code ----------
  List<Mesh> _meshes;
  List<double> _minAngles;
  List<Color> _c0;
  List<Color> _c1;
  List<int> _w0;
  List<int> _w1;
  BoundingBox _clippingBox;


  //
  public override void BeforeRunScript()
  {
    _meshes = new List<Mesh>();
    _minAngles = new List<double>();
    _c0 = new List<Color>();
    _c1 = new List<Color>();
    _w0 = new List<int>();
    _w1 = new List<int>();
    _clippingBox = new BoundingBox();
  }


  //
  List<Line> GetSilhouetteEdges(Mesh mesh, Point3d viewPoint, double minAngle, out List<Line> innerEdges)
  {
    List<Line> result = new List<Line>();
    innerEdges = new List<Line>();

    for(int i = 0;i < mesh.TopologyEdges.Count; i++)
    {
      int[] faces = mesh.TopologyEdges.GetConnectedFaces(i);

      if(faces.Length < 2)
      {
        result.Add(mesh.TopologyEdges.EdgeLine(i));
      }
      else
      {
        Vector3d n0 = mesh.FaceNormals[faces[0]];
        Vector3d n1 = mesh.FaceNormals[faces[1]];

        Point3d p0 = mesh.Faces.GetFaceCenter(faces[0]);
        Point3d p1 = mesh.Faces.GetFaceCenter(faces[1]);

        double d0 = (viewPoint - p0) * n0;
        double d1 = (viewPoint - p1) * n1;

        if(d0 < 0.0 ^ d1 < 0.0)
        {
          result.Add(mesh.TopologyEdges.EdgeLine(i));
        }
        else
        {
          double t = Vector3d.VectorAngle(n0, n1);
          if(t > minAngle)
            innerEdges.Add(mesh.TopologyEdges.EdgeLine(i));
        }
      }
    }

    return result;
  }


  //
  public override BoundingBox ClippingBox
  {
    get{return _clippingBox;}
  }


  //
  public override void DrawViewportWires (IGH_PreviewArgs args)
  {
    Point3d viewPt = RhinoDocument.Views.ActiveView.ActiveViewport.CameraLocation;

    for(int i = 0; i < _meshes.Count; i++)
    {
      List<Line> innerEdges;
      List<Line> lines = GetSilhouetteEdges(_meshes[i], viewPt, _minAngles[i], out innerEdges);
      args.Display.DrawLines(lines, _c0[i], _w0[i]);
      args.Display.DrawLines(innerEdges, _c1[i], _w1[i]);
      args.Display.DrawBoxCorners(_clippingBox, Color.Black);
    }
  }
# ---------- end c_script ----------

# ----
createatts_3 = CreateAttributes(LayerName="IsoContours", enableFullPath=False)
bake_3 = BakeGeometry(Bake=Button(), Geometry=move_8.Geometry, Attributes=createatts_3, DeleteOldBakes=False, PreserveTrees=False)
toolpath_resolution_2 = Slider(7.5, range=0..50)  # disabled
panel = Panel("""True
False""")  # disabled
dispatch_2 = Dispatch(List=dam, DispatchPattern=panel)  # -> ListA, ListB; disabled
divlength_3 = DivideLength(Curve=dispatch_2.ListA, Length=toolpath_resolution_2)  # -> Points, Tangents, Parameters; disabled
shift = ShiftList(List=divlength_3.Points, Shift=1, Wrap=True)  # disabled
cull = CullPattern(List=dam, CullPattern=[True, False])  # disabled
dist = Distance(PointA=divlength_3.Points, PointB=shift)  # -> expr("x*0.5", Distance); disabled
divlength_4 = DivideLength(Curve=dispatch_2.ListB, Length=toolpath_resolution_2)  # -> Points, Tangents, Parameters; disabled
unit = UnitVector(Vector=divlength_3.Tangents)  # disabled
amp = Amplitude(Vector=unit, Amplitude=dist)  # disabled
number_slider_2 = Slider(0.05, range=0..1)  # disabled
number_slider_3 = Slider(0.95, range=0..1)  # disabled
shift_2 = ShiftList(List=divlength_4.Points, Shift=1, Wrap=True)  # disabled
move_9 = Move(Geometry=divlength_3.Points, Motion=amp)  # -> Geometry, Transform; disabled
number_slider_4 = Slider(0.05, range=0..1)  # disabled
vec2pt_2 = Vector2Pt(PointA=divlength_4.Points, PointB=shift_2, Unitize=False)  # -> Vector, Length; disabled
shatter = Shatter(Curve=graft(dispatch_2.ListB), Parameters=divlength_4.Parameters)  # disabled
number_slider_5 = Slider(0.95, range=0..1)  # disabled
crv_cp = CurveClosestPoint(Point=move_9.Geometry, Curve=graft(dispatch_2.ListA))  # -> Point, Parameter, Distance; disabled
dom = ConstructDomain(DomainStart=number_slider_2, DomainEnd=number_slider_3)  # disabled
subcrv = SubCurve(BaseCurve=reparameterize(shatter), Domain=dom)  # disabled
# Bodies
shatter_2 = Shatter(Curve=graft(dispatch_2.ListA), Parameters=crv_cp.Parameter)  # disabled
dom_2 = ConstructDomain(DomainStart=number_slider_4, DomainEnd=number_slider_5)  # disabled
len_3 = Length(Curve=subcrv)  # -> expr("x*0.5", Length); disabled
len_4 = Length(Curve=subcrv)  # disabled
len_5 = Length(Curve=subcrv)  # -> expr("x*0.25", Length); disabled
curvepoint = PointOnCurve(subcrv, parameter=0.5)  # disabled
subcrv_2 = SubCurve(BaseCurve=reparameterize(shatter_2), Domain=dom_2)  # disabled
vec2pt_3 = Vector2Pt(PointA=divlength_3.Points, PointB=shift, Unitize=False)  # -> Vector, Length; disabled
len_6 = Length(Curve=subcrv_2)  # -> expr("x*0.5", Length); disabled
len_7 = Length(Curve=subcrv_2)  # -> expr("x*0.25", Length); disabled
len_8 = Length(Curve=subcrv_2)  # disabled
curvepoint_2 = PointOnCurve(subcrv_2, parameter=0.5)  # disabled
pl_2 = PlaneNormal(Origin=curvepoint, ZAxis=Vector(0, 0, 1))  # disabled
pl_3 = PlaneNormal(Origin=curvepoint_2, ZAxis=Vector(0, 0, 1))  # disabled
align = AlignPlane(Plane=pl_2, Direction=vec2pt_2.Vector)  # -> Plane, Angle; disabled
align_2 = AlignPlane(Plane=pl_3, Direction=vec2pt_3.Vector)  # -> Plane, Angle; disabled
box = CenterBox(Base=align.Plane, X=len_3, Y=len_5, Z=expr("x*0.5", layer_height))  # disabled
box_2 = CenterBox(Base=align_2.Plane, X=len_6, Y=len_7, Z=expr("x*0.5", layer_height))  # disabled
smesh = SimpleMesh(Brep=box)  # disabled
smesh_2 = SimpleMesh(Brep=box_2)  # disabled
flatten = FlattenTree(Tree=smesh, Path="{0}")  # disabled
flatten_2 = FlattenTree(Tree=smesh_2, Path="{0}")  # disabled
weld = WeldMesh(Mesh=flatten, Angle=3.141592654)  # disabled
weld_2 = WeldMesh(Mesh=flatten_2, Angle=3.141592654)  # disabled
merge_5 = Merge(Data1=weld_2, Data2=weld)  # disabled
swatch_2 = ColourSwatch(SwatchColor=RGB(255, 255, 255))  # disabled
swatch_3 = ColourSwatch(SwatchColor=RGB(87, 87, 87))  # disabled
mjoin_2 = MeshJoin(Meshes=flatten(merge_5))  # disabled
merge_6 = Merge(Data1=swatch_2, Data2=swatch_3)  # disabled
number_slider_6 = Slider(0.2, range=0..1)  # disabled
normshade_2 = NormalShader(Mesh=mjoin_2, Colors=merge_6, Direction=Vector(0, 0, 1))  # disabled
number_slider_7 = Slider(1, range=0..100)  # disabled
number_slider_8 = Slider(3, range=0..100)  # disabled
swatch_4 = ColourSwatch(SwatchColor=RGB(0, 0, 0))  # disabled
pi_2 = Pi(Factor=number_slider_6)  # disabled

# ---- group: Silhouette
c_script_2 = CSharpScript(mesh=normshade_2, c0=swatch_4, c1=swatch_4, w0=number_slider_8, w1=number_slider_7, minAngle=pi_2)  # -> out; inputs mesh: Mesh, c0: Color, c1: Color, w0: Int32, w1: Int32, minAngle: Double; disabled; same code as c_script

# ----
dam_2 = DataDam(DataA=merge_5, BufferDelay=10000000, BufferMode=0)  # disabled
number_slider_9 = Slider(1, range=0..1)  # disabled
number_slider_10 = Slider(1, range=0..1)  # disabled
number_slider_11 = Slider(1, range=0..1)  # disabled
number_slider_12 = Slider(1, range=0..1)  # disabled
brep = Brep(<brep referenced from the Rhino model>)  # disabled
box_3 = Box(brep)  # disabled
toggle = BooleanToggle(False)  # disabled
px_mat = PXMaterial(StaticFriction=number_slider_10, DynamicFriction=number_slider_10, Restitution=number_slider_9)  # disabled
px_mat_2 = PXMaterial(StaticFriction=number_slider_12, DynamicFriction=number_slider_12, Restitution=number_slider_11)  # disabled
# Simulation
mesh = Mesh(dam_2)  # disabled
number_slider_13 = Slider(1, range=0..100)  # disabled
px_cxmesh = PXConvexMesh(Mesh=mesh, Dynamic=True, MaterialProperty=px_mat_2)  # disabled
px_box = PXBox(Base=box_3, Dynamic=toggle, MaterialProperty=px_mat)  # disabled
button = Button()  # disabled
timer = Timer(TimerInterval=1, Target=px_simulate)  # disabled
px_simulate = PXSimulate(
    RigidBodies=flatten([px_cxmesh, px_box]),
    Gravity=Vector(0, 0, -9.8),
    Timestep=0.01,
    Steps=number_slider_13,
    Reset=button,
    Run=False)  # -> Info, Dynamics, Statics; disabled
mjoin_3 = MeshJoin(Meshes=flatten(px_simulate.Dynamics))  # disabled
area = Area(Geometry=px_simulate.Dynamics)  # -> Area, Centroid; disabled
swatch_5 = ColourSwatch(SwatchColor=RGB(255, 255, 255))  # disabled
swatch_6 = ColourSwatch(SwatchColor=RGB(105, 105, 105))  # disabled
c_script_3 = CSharpScript(x=area.Centroid)  # -> out, C, P; inputs x: list of Point3d; disabled
# ---------- c_script_3: C# ----------
    previous = current;
    current = x;

    P = previous;
    C = current;
# ---------- c_script_3: C# additional code ----------
  List<Point3d> current;
 List<Point3d> previous ;
# ---------- end c_script_3 ----------
merge_7 = Merge(Data1=swatch_5, Data2=swatch_6)  # disabled
vec2pt_4 = Vector2Pt(PointA=c_script_3.C, PointB=c_script_3.P, Unitize=False)  # -> Vector, flatten(Length); disabled
normshade_3 = NormalShader(Mesh=mjoin_3, Colors=merge_7, Direction=Vector(0, 0, 1))  # disabled
bnd = Bounds(Numbers=vec2pt_4.Length)  # disabled
remap = RemapNumbers(Value=vec2pt_4.Length, Source=bnd, Target=Domain(0, 1))  # -> Mapped, Clipped; disabled
swatch_7 = ColourSwatch(SwatchColor=RGB(255, 140, 0))  # disabled
swatch_8 = ColourSwatch(SwatchColor=RGB(251, 255, 0))  # disabled
swatch_9 = ColourSwatch(SwatchColor=RGB(255, 0, 0))  # disabled
swatch_10 = ColourSwatch(SwatchColor=RGB(21, 255, 0))  # disabled
number_slider_14 = Slider(0.1, range=0..1)  # disabled
merge_8 = Merge(Data1=swatch_10, Data2=swatch_8, Data3=swatch_7, Data4=swatch_9)  # disabled
interp = InterpolateData(Data=merge_8, Parameter=remap.Mapped, Interpolation=2)  # disabled
number_slider_15 = Slider(1, range=0..100)  # disabled
number_slider_16 = Slider(3, range=0..100)  # disabled
swatch_11 = ColourSwatch(SwatchColor=RGB(0, 0, 0))  # disabled
mcol = MeshColours(Mesh=graft(px_simulate.Dynamics), Colours=graft(interp))  # disabled
pi_3 = Pi(Factor=number_slider_14)  # disabled
mjoin_4 = MeshJoin(Meshes=flatten(mcol))  # disabled

# ---- group: Silhouette
c_script_4 = CSharpScript(mesh=mjoin_4, c0=swatch_11, c1=swatch_11, w0=number_slider_16, w1=number_slider_15, minAngle=pi_3)  # -> out; inputs mesh: Mesh, c0: Color, c1: Color, w0: Int32, w1: Int32, minAngle: Double; disabled; same code as c_script

# ==== cluster Cluster
G = ClusterInput()
C = ClusterInput()
L = ClusterInput()
end = EndPoints(Curve=C)  # -> Start, End
divlength = DivideLength(Curve=C, Length=L)  # -> Points, Tangents, Parameters
xy = XYPlane(Origin=end.Start)
pframe = PerpFrame(Curve=C, Parameter=divlength.Parameters)
F = ClusterOutput(pframe)

# ---- group: shiftedPlanes
orient = Orient(Geometry=G, Source=xy, Target=pframe)  # -> Geometry, Transform

# ----
G_2 = ClusterOutput(orient.Geometry)
lng = ListLength(List=orient.Geometry)
division = Division(A=1, B=lng)
series = Series(Start=0, Step=division, Count=lng)
S = ClusterOutput(series)
