# Grasshopper definition FRep_3DP.gh (Grasshopper 1.0.7)
# plug-ins: zFREP, Human, SpatialSlur.SlurGH

number_slider = Slider(50, range=0..100)
crv = Curve(<curve referenced from the Rhino model>)
mplane = MeshPlane(Boundary=crv, WidthCount=number_slider, HeightCount=number_slider)  # -> Mesh, Area
X = UnitX(Factor=expr("x*350 *-1", 1))
pt = Point([<point referenced from the Rhino model> x5])
move = Move(Geometry=flatten(pt), Motion=X)  # -> Geometry, Transform
crv_2 = Curve(<curve referenced from the Rhino model>)
crv_3 = Curve([<curve referenced from the Rhino model> x4])
topoly = CurveToPolyline(Curve=crv_2, ToleranceDistance=0, ToleranceAngle=0, MaxEdge=0.1)  # -> Polyline, Segments
meshfield_point = MeshFieldPoint(BaseMesh=mplane.Mesh, PointInput=move.Geometry, IsoValue=Slider(-0.85, range=-1..1))
merge = Merge(
    Data1=ColourSwatch(SwatchColor=RGB(255, 255, 255)),
    Data2=ColourSwatch(SwatchColor=RGB(54, 215, 255)),
    Data3=ColourSwatch(SwatchColor=RGB(0, 0, 0)))
mesh_field_curve = MeshFieldCurve(BaseMesh=mplane.Mesh, CurveInput=crv_3, IsoValue=Slider(0.3, range=-1..1))
mesh_field_curve_2 = MeshFieldCurve(BaseMesh=mplane.Mesh, CurveInput=topoly.Polyline, IsoValue=Slider(-0.5, range=-1..1))
field_display = FieldDisplay(Mesh=mplane.Mesh, Field=meshfield_point, Colors=merge)
X_2 = UnitX(Factor=expr("x*350", 1))
field_difference = FieldDifference(Field0=mesh_field_curve_2, Field1=mesh_field_curve)
move_2 = Move(Geometry=flatten(field_display), Motion=X_2)  # -> Geometry, Transform
merge_2 = Merge(
    Data1=ColourSwatch(SwatchColor=RGB(255, 255, 255)),
    Data2=ColourSwatch(SwatchColor=RGB(54, 215, 255)),
    Data3=ColourSwatch(SwatchColor=RGB(0, 0, 0)))
field_display_2 = FieldDisplay(Mesh=mplane.Mesh, Field=mesh_field_curve_2, Colors=merge_2)

# ---- group: Layer Height
layer_height = Slider(3.5, range=0..50)

# ----
isocontour = IsoContour(Mesh=mplane.Mesh, Field=field_difference, Iso=Slider(0.531, range=-1..1))  # disabled

# ---- group: normal crv
crv_4 = Curve(<curve referenced from the Rhino model>)

# ---- group: Orient
cluster = Cluster(G=mplane.Mesh, C=crv_4, L=layer_height)  # -> G_2, S, F

# ----
blend_fields = BlendFieldsMultiThreaded(BaseMesh=cluster.G_2, Field0=field_difference, Field1=meshfield_point, BlendParameters=cluster.S)
isocontour_2 = IsoContour(Mesh=cluster.G_2, Field=blend_fields, Iso=Slider(0.4, range=-1..1))
merge_3 = Merge(
    Data1=ColourSwatch(SwatchColor=RGB(255, 255, 255)),
    Data2=ColourSwatch(SwatchColor=RGB(54, 215, 255)),
    Data3=ColourSwatch(SwatchColor=RGB(0, 0, 0)))
smoothpline = SmoothPolyline(Polyline=isocontour_2, Strength=Slider(0.1, range=0..1), Times=Slider(50, range=0..1000))
field_display_3 = FieldDisplay(Mesh=cluster.G_2, Field=blend_fields, Colors=merge_3)
X_3 = UnitX(Factor=expr("x*700", 1))
move_3 = Move(Geometry=flatten(smoothpline), Motion=X_3)  # -> Geometry, Transform
X_4 = UnitX(Factor=expr("x*700", 1))
move_4 = Move(Geometry=flatten(field_display_3), Motion=X_4)  # -> Geometry, Transform
item = ListItem(List=move_4.Geometry, Index=0, Wrap=True)
len = Length(Curve=move_3.Geometry)
smaller = SmallerThan(FirstNumber=len, SecondNumber=Slider(100, range=0..100))  # -> SmallerThan, OrEqualTo
dispatch = Dispatch(List=move_3.Geometry, DispatchPattern=smaller.SmallerThan)  # -> ListA, ListB
lng = ListLength(List=move_4.Geometry)
explode = Explode(Curve=crv, Recursive=True)  # -> Segments, Vertices
demesh = DeconstructMesh(Mesh=move_4.Geometry)  # -> Vertices, Faces, Colours, Normals
divlength = DivideLength(Curve=reparameterize(dispatch.ListB), Length=Slider(1, range=0..100))  # -> Points, Tangents, Parameters
sqrt = SquareRoot(Value=lng)
len_2 = Length(Curve=explode.Segments)
# Fields Matrix
avr = Average(Input=demesh.Vertices)
pline = PolyLine(Vertices=divlength.Points, Closed=True)  # -> flatten(Polyline)
item_2 = ListItem(List=explode.Vertices, Index=0, Wrap=True)
round = Round(Number=sqrt)  # -> Nearest, Floor, Ceiling
item_3 = ListItem(List=len_2, Index=0, Wrap=True)
Y = UnitY(Factor=expr("x*-270", round.Ceiling))
previewlw = CustomPreviewLineweights(Geometry=pline, Shader=ColourSwatch(SwatchColor=RGB(209, 209, 209)), Thickness=Slider(3, range=0..10), Absolute=False)
move_5 = Move(Geometry=item_2, Motion=Y)  # -> Geometry, Transform
recgrid = Rectangular(Plane=move_5.Geometry, SizeX=item_3, SizeY=item_3, ExtentX=round.Ceiling, ExtentY=round.Nearest)  # -> flatten(Cells), Points
pcen = PolygonCenter(Polyline=recgrid.Cells)  # -> CenterV, CenterE, CenterA
toolpath_resolution = Slider(5, range=0..10)

# ---- group: Toolpath
dam = DataDam(DataA=pline, BufferDelay=10000000, BufferMode=1)

# ----
lng_2 = ListLength(List=pcen.CenterV)
subtraction = Subtraction(A=lng_2, B=lng)
divlength_2 = DivideLength(Curve=dam, Length=toolpath_resolution)  # -> Points, Tangents, Parameters
series = Series(Start=0, Step=1, Count=subtraction)
cull_i = CullIndex(List=pcen.CenterV, Indices=series, Wrap=True)  # -> graft(List)
cull_i_2 = CullIndex(List=recgrid.Cells, Indices=series, Wrap=True)  # -> graft(List)
Z = UnitZ(Factor=1)
# Toolpath Display
xprod = CrossProduct(VectorA=divlength_2.Tangents, VectorB=Z, Unitize=False)  # -> Vector, Length
vec2pt = Vector2Pt(PointA=avr, PointB=graft(cull_i), Unitize=False)  # -> Vector, Length
pl = ConstructPlane(Origin=divlength_2.Points, XAxis=xprod.Vector, YAxis=Z)
move_6 = Move(Geometry=graft(dam), Motion=vec2pt.Vector)  # -> Geometry, Transform
move_7 = Move(Geometry=graft(move_4.Geometry), Motion=vec2pt.Vector)  # -> flatten(Geometry), Transform
item_4 = ListItem(List=pl, Index=0, Wrap=True)
lng_3 = ListLength(List=pl)
previewlw_2 = CustomPreviewLineweights(Geometry=cull_i_2, Shader=ColourSwatch(SwatchColor=RGB(255, 255, 255)), Thickness=Slider(2, range=0..10), Absolute=False)
Z_2 = UnitZ(Factor=1)
ins = InsertItems(List=pl, Item=item_4, Indices=lng_3, Wrap=True)
move_8 = Move(Geometry=flatten(move_6.Geometry), Motion=Z_2)  # -> flatten(Geometry), Transform
cir = Circle(Plane=ins, Radius=Slider(1.5, range=0..50))
topoly_2 = CurveToPolyline(Curve=cir, ToleranceDistance=0, ToleranceAngle=0, MaxEdge=20)  # -> Polyline, Segments
previewlw_3 = CustomPreviewLineweights(
    Geometry=move_8.Geometry,
    Shader=ColourSwatch(SwatchColor=RGB(0, 0, 0)),
    Thickness=Slider(3, range=0..10),
    Absolute=False)
loft = MeshLoft(Polylines=topoly_2.Polyline)
merge_4 = Merge(Data1=ColourSwatch(SwatchColor=RGB(255, 255, 255)), Data2=ColourSwatch(SwatchColor=RGB(205, 79, 255)))
normshade = NormalShader(Mesh=loft, Colors=merge_4, Direction=Vector(0, 0, 1))
mjoin = MeshJoin(Meshes=flatten(normshade))
createatts = CreateAttributes(LayerName="Toolpath", enableFullPath=False)
createatts_2 = CreateAttributes(LayerName="Images", enableFullPath=False)
swatch = ColourSwatch(SwatchColor=RGB(0, 0, 0))
pi = Pi(Factor=Slider(0.2, range=0..1))
bake = BakeGeometry(Bake=Button(), Geometry=pline, Attributes=createatts, DeleteOldBakes=False, PreserveTrees=False)
bake_2 = BakeGeometry(Bake=Button(), Geometry=move_7.Geometry, Attributes=createatts_2, DeleteOldBakes=False, PreserveTrees=False)

# ---- group: Silhouette
c_script = CSharpScript(mesh=mjoin, c0=swatch, c1=swatch, w0=Slider(3, range=0..100), w1=Slider(1, range=0..100), minAngle=pi)  # -> out; inputs mesh: Mesh, c0: Color, c1: Color, w0: Int32, w1: Int32, minAngle: Double
# ---------- c_script: C# usings ----------
using System.IO;
using System.Linq;
using System.Data;
using System.Drawing;
using System.Reflection;
using System.Windows.Forms;
using System.Xml;
using System.Xml.Linq;
using System.Runtime.InteropServices;

using Rhino.DocObjects;
using Rhino.Collections;
using GH_IO;
using GH_IO.Serialization;
# ---------- c_script: C# ----------
    if(mesh == null)
      throw new ArgumentNullException();

    mesh.FaceNormals.ComputeFaceNormals();

    // cache display data
    _meshes.Add(mesh);
    _c0.Add(c0);
    _c1.Add(c1);
    _w0.Add(w0);
    _w1.Add(w1);
    _minAngles.Add(minAngle);

    //_clippingBox.Union(mesh.GetBoundingBox(false));
    _clippingBox = mesh.GetBoundingBox(false);
# ---------- c_script: C# additional code ----------
  List<Mesh> _meshes;
  List<double> _minAngles;
  List<Color> _c0;
  List<Color> _c1;
  List<int> _w0;
  List<int> _w1;
  BoundingBox _clippingBox;


  //
  public override void BeforeRunScript()
  {
    _meshes = new List<Mesh>();
    _minAngles = new List<double>();
    _c0 = new List<Color>();
    _c1 = new List<Color>();
    _w0 = new List<int>();
    _w1 = new List<int>();
    _clippingBox = new BoundingBox();
  }


  //
  List<Line> GetSilhouetteEdges(Mesh mesh, Point3d viewPoint, double minAngle, out List<Line> innerEdges)
  {
    List<Line> result = new List<Line>();
    innerEdges = new List<Line>();

    for(int i = 0;i < mesh.TopologyEdges.Count; i++)
    {
      int[] faces = mesh.TopologyEdges.GetConnectedFaces(i);

      if(faces.Length < 2)
      {
        result.Add(mesh.TopologyEdges.EdgeLine(i));
      }
      else
      {
        Vector3d n0 = mesh.FaceNormals[faces[0]];
        Vector3d n1 = mesh.FaceNormals[faces[1]];

        Point3d p0 = mesh.Faces.GetFaceCenter(faces[0]);
        Point3d p1 = mesh.Faces.GetFaceCenter(faces[1]);

        double d0 = (viewPoint - p0) * n0;
        double d1 = (viewPoint - p1) * n1;

        if(d0 < 0.0 ^ d1 < 0.0)
        {
          result.Add(mesh.TopologyEdges.EdgeLine(i));
        }
        else
        {
          double t = Vector3d.VectorAngle(n0, n1);
          if(t > minAngle)
            innerEdges.Add(mesh.TopologyEdges.EdgeLine(i));
        }
      }
    }

    return result;
  }


  //
  public override BoundingBox ClippingBox
  {
    get{return _clippingBox;}
  }


  //
  public override void DrawViewportWires (IGH_PreviewArgs args)
  {
    Point3d viewPt = RhinoDocument.Views.ActiveView.ActiveViewport.CameraLocation;

    for(int i = 0; i < _meshes.Count; i++)
    {
      List<Line> innerEdges;
      List<Line> lines = GetSilhouetteEdges(_meshes[i], viewPt, _minAngles[i], out innerEdges);
      args.Display.DrawLines(lines, _c0[i], _w0[i]);
      args.Display.DrawLines(innerEdges, _c1[i], _w1[i]);
      args.Display.DrawBoxCorners(_clippingBox, Color.Black);
    }
  }
# ---------- end c_script ----------

# ----
createatts_3 = CreateAttributes(LayerName="IsoContours", enableFullPath=False)
bake_3 = BakeGeometry(Bake=Button(), Geometry=move_8.Geometry, Attributes=createatts_3, DeleteOldBakes=False, PreserveTrees=False)
divlength_3 = DivideLength(Curve=dam, Length=Slider(5, range=0..5))  # -> Points, Tangents, Parameters
pl_2 = PlaneNormal(Origin=divlength_3.Points, ZAxis=Vector(0, 0, 1))
deplane = DeconstructPlane(Plane=pl_2)  # -> Origin, XAxis, expr("x*-1", YAxis), expr("x*-1", ZAxis)
merge_5 = Merge(Data1=graft(deplane.XAxis), Data2=graft(deplane.YAxis), Data3=graft(deplane.ZAxis))

# ---- group: Frames_TXT
c_script_2 = CSharpScript(position=deplane.Origin, rotation_X=deplane.XAxis, rotation_Y=deplane.YAxis, rotation_Z=deplane.ZAxis)  # -> out, flatten(result); inputs position: list of Point3d, rotation_X: list of Point3d, rotation_Y: list of Point3d, rotation_Z: list of Point3d
# ---------- c_script_2: C# ----------
    var output = new List<String>();

    for (int i = 0; i < position.Count(); i++)
    {
      var rotX_X = rotation_X[i].X.ToString("0.##");
      var rotX_Y = rotation_X[i].Y.ToString("0.##");
      var rotX_Z = rotation_X[i].Z.ToString("0.##");

      var rotY_X = rotation_Y[i].X.ToString("0.##");
      var rotY_Y = rotation_Y[i].Y.ToString("0.##");
      var rotY_Z = rotation_Y[i].Z.ToString("0.##");

      var rotZ_X = rotation_Z[i].X.ToString("0.##");
      var rotZ_Y = rotation_Z[i].Y.ToString("0.##");
      var rotZ_Z = rotation_Z[i].Z.ToString("0.##");

      var posX = position[i].X.ToString("0.##");
      var posY = position[i].Y.ToString("0.##");
      var posZ = position[i].Z.ToString("0.##");

      System.Text.StringBuilder sb = new System.Text.StringBuilder();

      sb.Append(rotX_X).Append(",").Append(rotX_Y).Append(",").Append(rotX_Z).Append(",");

      sb.Append(rotY_X).Append(",").Append(rotY_Y).Append(",").Append(rotY_Z).Append(",");

      sb.Append(rotZ_X).Append(",").Append(rotZ_Y).Append(",").Append(rotZ_Z).Append(",");

      sb.Append(posX).Append(",").Append(posY).Append(",").Append(posZ);

      string concatenated = sb.ToString();

      output.Insert(output.Count, concatenated);

    }

    result = output;
# ---------- end c_script_2 ----------

# ----
line = LineSDL(Start=graft(deplane.Origin), Direction=merge_5, Length=1)
merge_6 = Merge(
    Data1=ColourSwatch(SwatchColor=RGB(255, 0, 0)),
    Data2=ColourSwatch(SwatchColor=RGB(60, 255, 0)),
    Data3=ColourSwatch(SwatchColor=RGB(0, 4, 255)))
panel = Panel("C:\Users\Federico.B\Documents\Source\Repos\Alice2018_zSpace\ALICE_PLATFORM\x64\Release\EXE\data\NACHI_MZ07\")
previewlw_4 = CustomPreviewLineweights(Geometry=line, Shader=merge_6, Thickness=3, Absolute=False)
panel_2 = Panel(c_script_2.result)

# ---- group: Exporter
c_writetofile = CSharpScript(GCode=c_script_2.result, path=panel, name="path", write=Button())  # -> out, A; inputs GCode: list of String, path: String, name: String, write: Boolean
# ---------- c_writetofile: C# ----------
    string outputPath;

    outputPath = System.String.Format("{0}{1}.txt", path, name);

    System.IO.File.WriteAllLines(outputPath, GCode);
# ---------- end c_writetofile ----------

# ==== cluster Cluster
G = ClusterInput()
C = ClusterInput()
L = ClusterInput()
end = EndPoints(Curve=C)  # -> Start, End
divlength = DivideLength(Curve=C, Length=L)  # -> Points, Tangents, Parameters
xy = XYPlane(Origin=end.Start)
pframe = PerpFrame(Curve=C, Parameter=divlength.Parameters)
F = ClusterOutput(pframe)

# ---- group: shiftedPlanes
orient = Orient(Geometry=G, Source=xy, Target=pframe)  # -> Geometry, Transform

# ----
G_2 = ClusterOutput(orient.Geometry)
lng = ListLength(List=orient.Geometry)
division = Division(A=1, B=lng)
series = Series(Start=0, Step=division, Count=lng)
S = ClusterOutput(series)
